# Grasshopper definition 170411_OldValidation.gh (Grasshopper 0.9.76)
# plug-ins: GHSolar

# ---- group: urban context
brep = Brep([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])

# ---- group: Analysis Building
srf = Surface([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])

# ---- group: urban context mesh
mesh = Mesh(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)

# ----
panel = Panel("""0
1
2
3
4
5
6""")
panel_2 = Panel("""0
1
2
3
4
5
6""")
data = Data(["key:location/dataType/units/frequency/startsAt/endsAt", "Zuerich-Kloten", "Diffuse Horizontal Radiation", "Wh/m2", "Hourly", "(1, 1, 1)"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])
data_2 = Data(["key:location/dataType/units/frequency/startsAt/endsAt", "Zuerich-Kloten", "Direct Normal Radiation", "Wh/m2", "Hourly", "(1, 1, 1)"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])
cull_i = CullIndex(List=data, Indices=panel, Wrap=True)
cull_i_2 = CullIndex(List=data_2, Indices=panel_2, Wrap=True)
data_3 = Data(cull_i)
data_4 = Data([0, 0, 0, 0, 0, 0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])
data_5 = Data(cull_i_2)

# ---- group: obstacles
mesh_2 = Mesh(mesh)

# ----
srf_2 = Surface(srf)
debrep = DeconstructBrep(Brep=srf_2)  # -> Faces, Edges, Vertices
boundary = BoundarySurfaces(Edges=debrep.Edges)
mesh_uv = MeshSurface(Surface=boundary, UCount="10", VCount="10", Overhang=True, Equalize=False)
item = ListItem(List=flatten(mesh_uv), Index=Slider(4, range=0..5), Wrap=True)
mesh_3 = Mesh(mesh_uv)
mesh_4 = Mesh(item)

mesh_5 = Mesh(mesh_4)

# ---- group: weather
panel_3 = Panel(data_3)
panel_4 = Panel(data_4)
panel_5 = Panel(data_5)

# ----
mesh_6 = Mesh(flatten([mesh_3, mesh_2]))
panel_6 = Panel("""0
0
0
0
0
0""")
obstobj = ObstacleObject(Mesh=mesh_6, Albedo=panel_6, Reflection="0")

# ---- group: Latitude
panel_7 = Panel("47.367347")

# ---- group: Longitude
panel_8 = Panel("8.5500025")

# ----
irrmshh = IrradiationMeshhour(
    AnalysisMesh=mesh_5,
    ObstacleObjects=obstobj,
    Φ=panel_7,
    Λ=panel_8,
    DNI=panel_5,
    DHI=panel_3,
    Snow=panel_4,
    Year="2015",
    Month=Slider(1, range=1..12),
    Day=Slider(1, range=1..30),
    Hour=Slider(15, range=0..23),
    SkydomeResolution="2")  # -> TotalI, Ib, Ih, Vec
irrmshy = IrradiationMeshYear(
    AnalysisMesh=mesh_5,
    ObstacleObjects=obstobj,
    Latitude=panel_7,
    Longitude=panel_8,
    DNI=panel_5,
    DHI=panel_3,
    Snow=panel_4,
    Year="2015",
    SkydomeResolution="2",
    InterpolationMode="1",
    MT=Toggle(True))  # -> IAnnual, IbAnnual, IhAnnual, IHourly, IbHourly, IhHourly
panel_9 = Panel(irrmshh.TotalI)
matrix = Matrix(irrmshy.IHourly)

# ---- group: mesh visualization per hour of year
number_slider = Slider(2508, range=0..8759)  # disabled
c_script = CSharpScript(x=matrix, y=number_slider)  # -> out, A; inputs y: Int32; disabled
# ---------- c_script: C# ----------
    Matrix m = null;
    
    m = (Matrix)x;
    double [] test = new double[m.RowCount];
    for(int i = 0; i < m.RowCount; i++)
    {
      test[i] = m[i, y];
    }

    A = test;
# ---------- end c_script ----------
panel_10 = Panel(c_script.A)  # disabled

# ----
c_script_2 = CSharpScript(x=panel_9)  # -> out, A; inputs x: list of Double
# ---------- c_script_2: C# ----------
    //    Dim m As matrix
    //    m = x
    //
    //    Dim test(m.ColumnCount - 1) As Double
    //    Dim i As Integer
    //    For i = 1 To m.ColumnCount - 1
    //    test(i - 1) = m.item(y, i)
    //    Next
    //
    //      A = test

    List<double> m = new List<double>();

    double test = 0;
    for(int i = 0; i < x.Count; i++)
    {
      test += x[i];
    }
    test /= x.Count;

    A = test;
# ---------- end c_script_2 ----------
c_script_3 = CSharpScript(x=matrix)  # -> out, A
# ---------- c_script_3: C# ----------
    //    Dim m As matrix
    //    m = x
    //
    //    Dim test(m.ColumnCount - 1) As Double
    //    Dim i As Integer
    //    For i = 1 To m.ColumnCount - 1
    //    test(i - 1) = m.item(y, i)
    //    Next
    //
    //      A = test

    Matrix m = null;

    m = (Matrix) x;
    double [] test = new double[m.ColumnCount];
    for(int i = 0; i < m.ColumnCount; i++)
    {
      for(int u = 0; u < m.RowCount; u++)
      {
        test[i] += m[u, i];
      }
      test[i] /= m.RowCount;
    }

    A = test;
# ---------- end c_script_3 ----------

# ---- group: 8760 profiles foreach vertex
c_script_4 = CSharpScript(x=matrix, y=Slider(60, range=0..120))  # -> out, A; inputs y: Int32
# ---------- c_script_4: C# ----------
    //    Dim m As matrix
    //    m = x
    //
    //    Dim test(m.ColumnCount - 1) As Double
    //    Dim i As Integer
    //    For i = 1 To m.ColumnCount - 1
    //    test(i - 1) = m.item(y, i)
    //    Next
    //
    //      A = test

    Matrix m = null;

    m = (Matrix) x;
    double [] test = new double[m.ColumnCount];
    for(int i = 0; i < m.ColumnCount; i++)
    {
      test[i] = m[y, i];
    }

    A = test;
# ---------- end c_script_4 ----------
panel_11 = Panel(c_script_3.A)

# ----
panel_12 = Panel(c_script_2.A)

# ---- group: Visualize
visumshsol = VisualizeMeshSolar(Mesh=mesh_5, I=irrmshy.IAnnual, Min="0", Max="1000", Clr=Slider(1, range=0..2))
