# Grasshopper definition GHSolar_Template.gh (Grasshopper 1.0.7)
# plug-ins: GHSolar

# ---- group: Multi-threading?
toggle = BooleanToggle(True)

# ---- group: analysis surface
srf = Surface([<surface referenced from the Rhino model> x2])
mesh_uv = MeshSurface(Surface=srf, UCount=Slider(10, range=0..100), VCount=Slider(5, range=0..100), Overhang=True, Equalize=False)
mesh = Mesh(mesh_uv)

# ---- group: example how to load data
readtxt = ReadText(Path="C:\Users\wach\Desktop\SolarV2\leaves_light.txt")

# ---- group: ground
mesh_2 = Mesh(<mesh referenced from the Rhino model>)

# ---- group: adjacent buildings
mesh_3 = Mesh([<mesh referenced from the Rhino model> x2])

# ---- group: obstacles diffuse
data = Data([0.8, 0.8, 0.8, 0.8, 0.8, 0.8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])
panel = Panel(data)
mesh_4 = Mesh([mesh_3, mesh_2])
obstobj = ObstacleObject(Mesh=mesh_4, Albedo=panel, SpecCoeff=panel, ReflType="0", Tolerance="0.01", Name="stuff", MT=toggle)

# ---- group: reflecting srfs like windows
mesh_5 = Mesh(<mesh referenced from the Rhino model>)

# ---- group: obstacles specular
data_2 = Data([0.8, 0.8, 0.8, 0.8, 0.8, 0.8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])
panel_2 = Panel(data_2)
obstobj_2 = ObstacleObject(Mesh=mesh_5, Albedo=panel_2, SpecCoeff=panel_2, ReflType="1", Tolerance="0.01", Name="windows", MT=toggle)

# ---- group: Analysis surface object
data_3 = Data([0.8, 0.8, 0.8, 0.8, 0.8, 0.8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])
panel_3 = Panel(data_3)
obstobj_3 = ObstacleObject(Mesh=mesh, Albedo=panel_3, SpecCoeff=[panel, panel_3], ReflType="0", Tolerance="0.01", Name="analysis", MT=toggle)

# ---- group: Trees
data_4 = Data([0.1, 0.1, 0.1, 0.1, 0.1, 0.1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])
mesh_6 = Mesh(<mesh referenced from the Rhino model>)
data_5 = Data([0.8, 0.8, 0.8, 0.8, 0.8, 0.8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])
mesh_7 = Mesh(<mesh referenced from the Rhino model>)
mesh_8 = Mesh(<mesh referenced from the Rhino model>)
data_6 = Data([0.5, 0.5, 0.5, 0.5, 0.5, 0.5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])
treeobst = TreeObstacle(Mesh=mesh_8, Leaves=data_4)
treeobst_2 = TreeObstacle(Mesh=mesh_7, Leaves=data_6)
treeobst_3 = TreeObstacle(Mesh=mesh_6, Leaves=data_5)

# ---- group: set to 1 or 2, if you want specular refl. careful: expensive!
panel_4 = Panel("0")

# ----
item = ListItem(List=mesh, Index="0", Wrap=True)

# ---- group: ANNUAL SIMULATION
data_7 = Data([0, 0, 0, 0, 0, 0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])
data_8 = Data([-65.34878984, -62.13426796, -54.95901857, -45.81747693, -35.88714072, -25.78253978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])
# Activate this component to simulate
data_9 = Data([0, 0, 0, 0, 0, 0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])
data_10 = Data([8.415567703, 33.69912388, 56.58914543, 72.99109311, 85.75265625, 96.74276768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])
irrmshy = IrradiationMeshYear(
    AnalysisObjects=obstobj_3,
    ObstacleObjects=[obstobj_2, obstobj],
    TreeObject=[treeobst, treeobst_2, treeobst_3],
    Latitude=47.479,
    Longitude=8.53,
    Year=2013,
    DNI=data_9,
    DHI=data_7,
    Azimuth=data_10,
    Altitude=data_8,
    MainSkyRes=2,
    MainInterpMode=1,
    SpecBounces=panel_4,
    SpecInterpMode=0,
    DiffIReflMode=2,
    MT=toggle,
    Timezone=Slider(0, range=-8..8))  # disabled
visumshsol = VisualizeMeshSolar(Mesh=mesh, I=irrmshy, Value="0", Hour=Slider(370, range=0..8759), Min="0", Max="1000000", Clr=Slider(1, range=0..2))
readresults = ReadResults(Mesh=mesh, I=irrmshy, Value=Slider(7, range=0..7), SP=Slider(47, range=0..100))  # -> Results, SP

# ----
item_2 = ListItem(List=irrmshy, Index="0", Wrap=True)
readresultsavg = ReadResultsAvg(Mesh=item, I=item_2, Value="3")  # -> AvgI, Area

# ---- group: ANNUAL SIMULATION (continued)
panel_5 = Panel(readresultsavg.AvgI)
