# Grasshopper definition GHSolar_Test.gh (Grasshopper 1.0.7)
# plug-ins: GHSolar

srf = Surface(<surface referenced from the Rhino model>)
mesh_uv = MeshSurface(Surface=srf, UCount="2", VCount="2", Overhang=True, Equalize=False)
item = ListItem(List=flatten(mesh_uv), Index=0, Wrap=True)
mesh = Mesh(item)

matrix = Matrix()

# ---- group: 8760 profiles foreach vertex
c_script = CSharpScript(x=matrix, y=Slider(75, range=0..120))  # -> out, A; inputs y: Int32
# ---------- c_script: C# ----------
//    Dim m As matrix
//    m = x
//
//    Dim test(m.ColumnCount - 1) As Double
//    Dim i As Integer
//    For i = 1 To m.ColumnCount - 1
//    test(i - 1) = m.item(y, i)
//    Next
//
//      A = test
    
    Matrix m = null;

    m = (Matrix) x;
    double [] test = new double[m.ColumnCount];
    for(int i = 0; i < m.ColumnCount; i++)
    {
      test[i] = m[y,i];
    }

    A = test;
# ---------- end c_script ----------
panel = Panel(c_script.A)

# ---- group: mesh visualization per hour of year
c_script_2 = CSharpScript(x=matrix, y=Slider(2508, range=0..8759))  # -> out, A; inputs y: Int32
# ---------- c_script_2: C# ----------
    Matrix m = null;
    
    m = (Matrix)x;
    double [] test = new double[m.RowCount];
    for(int i = 0; i < m.RowCount; i++)
    {
      test[i] = m[i, y];
    }

    A = test;
# ---------- end c_script_2 ----------
panel_2 = Panel(c_script_2.A)

# ----
mesh_2 = Mesh([<mesh referenced from the Rhino model> x100])

# ---- group: albedos
readtxt = ReadText(Path="C:\Users\wach\Desktop\SolarV2\albedosGlass.txt")

# ----
mjoin = MeshJoin(Meshes=mesh_2)

# ---- group: analysis surface
srf_2 = Surface(<surface referenced from the Rhino model>)
mesh_uv_2 = MeshSurface(Surface=srf_2, UCount=Slider(50, range=0..100), VCount=Slider(20, range=0..100), Overhang=True, Equalize=False)
mesh_3 = Mesh(mesh_uv_2)

# ----
panel_3 = Panel("H:\PROJEKTE\15_Solar Model\4_CASESTUDY\V2\Validation\weather data\AZIMUTH.txt")
panel_4 = Panel("H:\PROJEKTE\15_Solar Model\4_CASESTUDY\V2\Validation\weather data\ALTITUDE.txt")

# ---- group: Data reader
readtxt_2 = ReadText(Path="C:\Users\wach\Desktop\SolarV2\DNI.txt")
readtxt_3 = ReadText(Path="C:\Users\wach\Desktop\SolarV2\DHI.txt")
readtxt_4 = ReadText(Path="C:\Users\wach\Desktop\SolarV2\SNOW.txt")

# ---- group: Self-obstruction with low resolution
mesh_uv_3 = MeshSurface(Surface=srf_2, UCount=Slider(1, range=0..100), VCount=Slider(1, range=0..100), Overhang=True, Equalize=False)

# ---- group: obstacles diffuse
data = Data([0.8, 0.8, 0.8, 0.8, 0.8, 0.8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])
srf_3 = Surface([<surface referenced from the Rhino model> x2])
panel_5 = Panel(data)
mesh_uv_4 = MeshSurface(Surface=srf_3, UCount=Slider(1, range=0..100), VCount=Slider(1, range=0..100), Overhang=True, Equalize=False)
mesh_4 = Mesh(mesh_uv_4)
mesh_5 = Mesh([mesh_uv_3, mesh_4])
obstobj = ObstacleObject(Mesh=mesh_5, Albedo=panel_5, SpecCoeff=panel_5, ReflType="0", Tolerance="0.01", Name="stuff", MT=Toggle(True))

# ---- group: obstacles specular
data_2 = Data([0.8, 0.8, 0.8, 0.8, 0.8, 0.8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])
panel_6 = Panel(data_2)
mesh_6 = Mesh(<mesh referenced from the Rhino model>)
obstobj_2 = ObstacleObject(Mesh=mesh_6, Albedo=panel_6, SpecCoeff=panel_6, ReflType="1", Tolerance="0.01", Name="windows", MT=Toggle(True))

# ---- group: trees medium
readtxt_5 = ReadText(Path="C:\Users\wach\Desktop\SolarV2\leaves_medium.txt")

# ---- group: trees light
readtxt_6 = ReadText(Path="C:\Users\wach\Desktop\SolarV2\leaves_light.txt")

# ---- group: trees dense
readtxt_7 = ReadText(Path="C:\Users\wach\Desktop\SolarV2\leaves_dense.txt")

# ----
readtxt_8 = ReadText(Path=panel_3)
readtxt_9 = ReadText(Path=panel_4)
data_3 = Data([0, 0, 0, 0, 0, 0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])
data_4 = Data([0, 0, 0, 0, 0, 0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])
data_5 = Data([0, 0, 0, 0, 0, 0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])

# ---- group: AZIMUTH
data_6 = Data([8.415567703, 33.69912388, 56.58914543, 72.99109311, 85.75265625, 96.74276768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])

# ---- group: ALTITUDE
data_7 = Data([-65.34878984, -62.13426796, -54.95901857, -45.81747693, -35.88714072, -25.78253978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])

# ---- group: Analysis surface object
data_8 = Data([0.8, 0.8, 0.8, 0.8, 0.8, 0.8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])
panel_7 = Panel(data_8)
obstobj_3 = ObstacleObject(
    Mesh=mesh_3,
    Albedo=panel_7,
    SpecCoeff=[panel_5, panel_7],
    ReflType="0",
    Tolerance="0.01",
    Name="analysis",
    MT=Toggle(True))

# ---- group: Trees
data_9 = Data([0.1, 0.1, 0.1, 0.1, 0.1, 0.1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])
mesh_7 = Mesh(<mesh referenced from the Rhino model>)
data_10 = Data([0.8, 0.8, 0.8, 0.8, 0.8, 0.8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])
mesh_8 = Mesh(<mesh referenced from the Rhino model>)
mesh_9 = Mesh(<mesh referenced from the Rhino model>)
data_11 = Data([0.5, 0.5, 0.5, 0.5, 0.5, 0.5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])
treeobst = TreeObstacle(Mesh=mesh_9, Leaves=data_9)
treeobst_2 = TreeObstacle(Mesh=mesh_8, Leaves=data_11)
treeobst_3 = TreeObstacle(Mesh=mesh_7, Leaves=data_10)

# ---- group: weather
panel_8 = Panel(data_3)
panel_9 = Panel(data_4)
panel_10 = Panel(data_5)

# ---- group: Latitude
panel_11 = Panel("47.479")

# ---- group: Longitude
panel_12 = Panel("8.530")

# ---- group: year
panel_13 = Panel("2013")

# ---- group: ANNUAL SIMULATION
# Activate this component for annual simulation
panel_14 = Panel("0")
irrmshy = IrradiationMeshYear(
    AnalysisObjects=obstobj_3,
    ObstacleObjects=[obstobj_2, obstobj],
    TreeObject=[treeobst, treeobst_2, treeobst_3],
    Latitude=panel_11,
    Longitude=panel_12,
    Year=panel_13,
    DNI=panel_10,
    DHI=panel_8,
    Azimuth=data_6,
    Altitude=data_7,
    MainSkyRes=panel_14,
    MainInterpMode="0",
    SpecBounces="0",
    SpecInterpMode="0",
    DiffIReflMode="0",
    Timezone=Slider(0, range=-8..8))  # disabled
visumshsol = VisualizeMeshSolar(Mesh=mesh_3, I=irrmshy, Value="4", Hour=Slider(277, range=0..8759), Min="0", Max="900", Clr=Slider(1, range=0..2))
readresults = ReadResults(Mesh=mesh_3, I=irrmshy, Value=Slider(4, range=0..7), SP=Slider(10, range=0..100))  # -> Results, SP
panel_15 = Panel(readresults.Results)

# ---- group: HOURLY SIMULATION
# Activate this component for hourly simulation
number_slider = Slider(1, range=1..12)
data_12 = Data("Grasshopper.Kernel.Types.GH_ObjectWrapper")
irrmshh = IrradiationMeshhour(
    AnalysisObjects=obstobj_3,
    ObstacleObjects=[obstobj_2, obstobj],
    TreeObject=[treeobst, treeobst_2, treeobst_3],
    Latitude=panel_11,
    Longitude=panel_12,
    Year=panel_13,
    Month=number_slider,
    Day=Slider(2, range=1..12),
    Hour=Slider(10, range=0..23),
    DNI=panel_10,
    DHI=panel_8,
    Azimuth=data_6,
    Altitude=data_7,
    MainSkyRes="0",
    SpecBounces="0",
    DiffIReflSkyRes="0",
    MT=Toggle(True),
    Timezone=Slider(0, range=-8..8))  # -> Vec, Results, Irefl; disabled
readresults_2 = ReadResults(Mesh=mesh_3, I=irrmshh.Results, Value=Slider(4, range=0..7), SP=Slider(5, range=0..100))  # -> Results, SP
visumshsol_2 = VisualizeMeshSolar(Mesh=mesh_3, I=irrmshh.Results, Value="4", Hour=Slider(0, range=0..8759), Min="0", Max="1000", Clr=Slider(1, range=0..2))
panel_16 = Panel(readresults_2.Results)
