# Grasshopper definition GHSolar_Test.gh (Grasshopper 0.9.76)
# plug-ins: GHSolar

srf = Surface(<surface referenced from the Rhino model>)
mesh_uv = MeshSurface(Surface=srf, UCount="2", VCount="2", Overhang=True, Equalize=False)
item = ListItem(List=flatten(mesh_uv), Index=0, Wrap=True)
mesh = Mesh(item)

matrix = Matrix()  # disabled

# ---- group: 8760 profiles foreach vertex
number_slider = Slider(75, range=0..120)  # disabled
c_script = CSharpScript(x=matrix, y=number_slider)  # -> out, A; inputs y: Int32; disabled
# ---------- c_script: C# ----------
//    Dim m As matrix
//    m = x
//
//    Dim test(m.ColumnCount - 1) As Double
//    Dim i As Integer
//    For i = 1 To m.ColumnCount - 1
//    test(i - 1) = m.item(y, i)
//    Next
//
//      A = test
    
    Matrix m = null;

    m = (Matrix) x;
    double [] test = new double[m.ColumnCount];
    for(int i = 0; i < m.ColumnCount; i++)
    {
      test[i] = m[y,i];
    }

    A = test;
# ---------- end c_script ----------
panel = Panel(c_script.A)  # disabled

# ---- group: mesh visualization per hour of year
number_slider_2 = Slider(2508, range=0..8759)  # disabled
c_script_2 = CSharpScript(x=matrix, y=number_slider_2)  # -> out, A; inputs y: Int32; disabled
# ---------- c_script_2: C# ----------
    Matrix m = null;
    
    m = (Matrix)x;
    double [] test = new double[m.RowCount];
    for(int i = 0; i < m.RowCount; i++)
    {
      test[i] = m[i, y];
    }

    A = test;
# ---------- end c_script_2 ----------
panel_2 = Panel(c_script_2.A)  # disabled

# ----
mesh_2 = Mesh([<mesh referenced from the Rhino model> x100])

# ---- group: albedos
panel_3 = Panel("C:\Users\wach\Desktop\SolarV2\albedosGlass.txt")  # disabled
readtxt = ReadText(Path=panel_3)  # disabled

# ----
mjoin = MeshJoin(Meshes=mesh_2)

# ---- group: analysis surface
srf_2 = Surface(<surface referenced from the Rhino model>)
mesh_uv_2 = MeshSurface(Surface=srf_2, UCount=Slider(50, range=0..100), VCount=Slider(20, range=0..100), Overhang=True, Equalize=False)
mesh_3 = Mesh(mesh_uv_2)

# ----
panel_4 = Panel("H:\PROJEKTE\15_Solar Model\4_CASESTUDY\V2\Validation\weather data\AZIMUTH.txt")  # disabled
panel_5 = Panel("H:\PROJEKTE\15_Solar Model\4_CASESTUDY\V2\Validation\weather data\ALTITUDE.txt")  # disabled

# ---- group: Data reader
panel_6 = Panel("C:\Users\wach\Desktop\SolarV2\DNI.txt")  # disabled
panel_7 = Panel("C:\Users\wach\Desktop\SolarV2\DHI.txt")  # disabled
panel_8 = Panel("C:\Users\wach\Desktop\SolarV2\SNOW.txt")  # disabled
readtxt_2 = ReadText(Path=panel_6)  # disabled
readtxt_3 = ReadText(Path=panel_7)  # disabled
readtxt_4 = ReadText(Path=panel_8)  # disabled

# ---- group: Self-obstruction with low resolution
mesh_uv_3 = MeshSurface(Surface=srf_2, UCount=Slider(1, range=0..100), VCount=Slider(1, range=0..100), Overhang=True, Equalize=False)

# ---- group: obstacles diffuse
data = Data([0.8, 0.8, 0.8, 0.8, 0.8, 0.8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])
srf_3 = Surface([<surface referenced from the Rhino model> x2])
panel_9 = Panel(data)
mesh_uv_4 = MeshSurface(Surface=srf_3, UCount=Slider(1, range=0..100), VCount=Slider(1, range=0..100), Overhang=True, Equalize=False)
mesh_4 = Mesh(mesh_uv_4)
mesh_5 = Mesh([mesh_uv_3, mesh_4])
obstobj = ObstacleObject(Mesh=mesh_5, Albedo=panel_9, SpecCoeff=panel_9, ReflType="0", Tolerance="0.01", Name="stuff", MT=Toggle(True))

# ---- group: obstacles specular
data_2 = Data([0.8, 0.8, 0.8, 0.8, 0.8, 0.8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])
panel_10 = Panel(data_2)
mesh_6 = Mesh(<mesh referenced from the Rhino model>)
obstobj_2 = ObstacleObject(Mesh=mesh_6, Albedo=panel_10, SpecCoeff=panel_10, ReflType="1", Tolerance="0.01", Name="windows", MT=Toggle(True))

# ---- group: trees medium
panel_11 = Panel("C:\Users\wach\Desktop\SolarV2\leaves_medium.txt")  # disabled
readtxt_5 = ReadText(Path=panel_11)  # disabled

# ---- group: trees light
panel_12 = Panel("C:\Users\wach\Desktop\SolarV2\leaves_light.txt")  # disabled
readtxt_6 = ReadText(Path=panel_12)  # disabled

# ---- group: trees dense
panel_13 = Panel("C:\Users\wach\Desktop\SolarV2\leaves_dense.txt")  # disabled
readtxt_7 = ReadText(Path=panel_13)  # disabled

# ----
readtxt_8 = ReadText(Path=panel_4)  # disabled
readtxt_9 = ReadText(Path=panel_5)  # disabled
data_3 = Data([0, 0, 0, 0, 0, 0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])
data_4 = Data([0, 0, 0, 0, 0, 0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])
data_5 = Data([0, 0, 0, 0, 0, 0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])

# ---- group: AZIMUTH
data_6 = Data([8.415567703, 33.69912388, 56.58914543, 72.99109311, 85.75265625, 96.74276768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])

# ---- group: ALTITUDE
data_7 = Data([-65.34878984, -62.13426796, -54.95901857, -45.81747693, -35.88714072, -25.78253978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])

# ---- group: Analysis surface object
data_8 = Data([0.8, 0.8, 0.8, 0.8, 0.8, 0.8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])
panel_14 = Panel(data_8)
obstobj_3 = ObstacleObject(
    Mesh=mesh_3,
    Albedo=panel_14,
    SpecCoeff=[panel_9, panel_14],
    ReflType="0",
    Tolerance="0.01",
    Name="analysis",
    MT=Toggle(True))

# ---- group: Trees
data_9 = Data([0.1, 0.1, 0.1, 0.1, 0.1, 0.1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])
mesh_7 = Mesh(<mesh referenced from the Rhino model>)
data_10 = Data([0.8, 0.8, 0.8, 0.8, 0.8, 0.8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])
mesh_8 = Mesh(<mesh referenced from the Rhino model>)
mesh_9 = Mesh(<mesh referenced from the Rhino model>)
data_11 = Data([0.5, 0.5, 0.5, 0.5, 0.5, 0.5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])
treeobst = TreeObstacle(Mesh=mesh_9, Leaves=data_9)
treeobst_2 = TreeObstacle(Mesh=mesh_8, Leaves=data_11)
treeobst_3 = TreeObstacle(Mesh=mesh_7, Leaves=data_10)

# ---- group: weather
panel_15 = Panel(data_3)
panel_16 = Panel(data_4)
panel_17 = Panel(data_5)

# ---- group: Latitude
panel_18 = Panel("47.479")

# ---- group: Longitude
panel_19 = Panel("8.530")

# ---- group: year
panel_20 = Panel("2013")

# ---- group: ANNUAL SIMULATION
panel_21 = Panel("0")  # disabled
panel_22 = Panel("0")  # disabled
panel_23 = Panel("0")  # disabled
panel_24 = Panel("0")  # disabled
panel_25 = Panel("0")  # disabled
irrmshy = IrradiationMeshYear(
    AnalysisObjects=obstobj_3,
    ObstacleObjects=[obstobj_2, obstobj],
    TreeObject=[treeobst, treeobst_2, treeobst_3],
    Latitude=panel_18,
    Longitude=panel_19,
    Year=panel_20,
    DNI=panel_17,
    DHI=panel_15,
    Azimuth=data_6,
    Altitude=data_7,
    MainSkyRes=panel_23,
    MainInterpMode=panel_24,
    SpecBounces=panel_21,
    SpecInterpMode=panel_25,
    DiffIReflMode=panel_22)  # disabled
number_slider_3 = Slider(277, range=0..8759)  # disabled
number_slider_4 = Slider(1, range=0..2)  # disabled
panel_26 = Panel("4")  # disabled
panel_27 = Panel("0")  # disabled
panel_28 = Panel("900")  # disabled
number_slider_5 = Slider(10, range=0..100)  # disabled
number_slider_6 = Slider(4, range=0..7)  # disabled
visumshsol = VisualizeMeshSolar(Mesh=mesh_3, I=irrmshy, Value=panel_26, Hour=number_slider_3, Min=panel_27, Max=panel_28, Clr=number_slider_4)  # disabled
readresults = ReadResults(Mesh=mesh_3, I=irrmshy, Value=number_slider_6, SP=number_slider_5)  # -> Results, SP; disabled
panel_29 = Panel(readresults.Results)  # disabled

# ---- group: HOURLY SIMULATION
data_12 = Data("Grasshopper.Kernel.Types.GH_ObjectWrapper")
irrmshh = IrradiationMeshhour(
    AnalysisObjects=obstobj_3,
    ObstacleObjects=[obstobj_2, obstobj],
    TreeObject=[treeobst, treeobst_2, treeobst_3],
    Latitude=panel_18,
    Longitude=panel_19,
    Year=panel_20,
    Month=Slider(1, range=1..12),
    Day=Slider(2, range=1..12),
    Hour=Slider(10, range=0..23),
    DNI=panel_17,
    DHI=panel_15,
    Azimuth=data_6,
    Altitude=data_7,
    MainSkyRes="0",
    SpecBounces="0",
    DiffIReflSkyRes="0",
    MT=Toggle(True))  # -> Vec, Results, Irefl
readresults_2 = ReadResults(Mesh=mesh_3, I=irrmshh.Results, Value=Slider(4, range=0..7), SP=Slider(5, range=0..100))  # -> Results, SP
visumshsol_2 = VisualizeMeshSolar(Mesh=mesh_3, I=irrmshh.Results, Value="4", Hour=Slider(0, range=0..8759), Min="0", Max="1000", Clr=Slider(1, range=0..2))
panel_30 = Panel(readresults_2.Results)
