# Grasshopper definition caseB.gh (Grasshopper 0.9.76)
# plug-ins: Python Interpreter, ItemSelector, GHSolar

# ---- group: urban context
brep = Brep([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])

# ---- group: Analysis Building
srf = Surface([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])

# ---- group: urban context mesh
mesh = Mesh(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)

# ---- group: Ground
mesh_2 = Mesh(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)

# ---- group: Analysis Building for HoneybeeEplus
brep_2 = Brep([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])

# ---- group: weathher file
weather_file = FilePath("H:\PROJEKTE\15_Solar Model\4_CASESTUDY\V2\Validation\weather data Zurich\CH_ZH_original.epw")

# ----
mesh_3 = Mesh(brep)
srf_2 = Surface(<surface referenced from the Rhino model>)

# ---- group: analysis surface
item = ListItem(List=srf, Index=Slider(1, range=0..4), Wrap=True)
offset = Offset(Surface=item, Distance="0.001", Retrim=True)
srf_3 = Surface(srf_2)
mesh_uv = MeshSurface(Surface=srf_3, UCount=Slider(2, range=0..100), VCount=Slider(2, range=0..100), Overhang=True, Equalize=False)
mesh_4 = Mesh(mesh_uv)

# ---- group: albedos
panel = Panel("H:\PROJEKTE\15_Solar Model\4_CASESTUDY\V2\Validation\weather data\albedo03.txt")  # disabled
readtxt = ReadText(Path=panel)  # disabled

# ----
panel_2 = Panel("H:\PROJEKTE\15_Solar Model\4_CASESTUDY\V2\Validation\weather data\AZIMUTH.txt")  # disabled
panel_3 = Panel("H:\PROJEKTE\15_Solar Model\4_CASESTUDY\V2\Validation\weather data\ALTITUDE.txt")  # disabled
readtxt_2 = ReadText(Path=panel_2)  # disabled
readtxt_3 = ReadText(Path=panel_3)  # disabled
data = Data([0, 0, 0, 0, 0, 0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])
data_2 = Data([0, 0, 0, 0, 0, 0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])
data_3 = Data([0, 0, 0, 0, 0, 0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])

# ---- group: albedos
panel_4 = Panel("H:\PROJEKTE\15_Solar Model\4_CASESTUDY\V2\Validation\weather data Zurich\albedo02.txt")  # disabled
readtxt_4 = ReadText(Path=panel_4)  # disabled

# ---- group: Data reader
panel_5 = Panel("H:\PROJEKTE\15_Solar Model\4_CASESTUDY\V2\Validation\weather data\DNI.txt")  # disabled
panel_6 = Panel("H:\PROJEKTE\15_Solar Model\4_CASESTUDY\V2\Validation\weather data\DHI.txt")  # disabled
panel_7 = Panel("H:\PROJEKTE\15_Solar Model\4_CASESTUDY\V2\Validation\weather data\nosnow.txt")  # disabled
readtxt_5 = ReadText(Path=panel_5)  # disabled
readtxt_6 = ReadText(Path=panel_6)  # disabled
readtxt_7 = ReadText(Path=panel_7)  # disabled

# ---- group: obstacles diffuse
data_4 = Data([0.3, 0.3, 0.3, 0.3, 0.3, 0.3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])
panel_8 = Panel(data_4)
mesh_uv_2 = MeshSurface(Surface=srf, UCount=Slider(1, range=0..100), VCount=Slider(1, range=0..100), Overhang=True, Equalize=False)
mesh_5 = Mesh([mesh_uv_2, mesh_3])
obstobj = ObstacleObject(Mesh=mesh_5, Albedo=panel_8, SpecCoeff=panel_8, ReflType="0", Tolerance="0.01", Name="stuff", MT=Toggle(True))

# ----
number_slider = Slider(2, range=0..8)  # disabled

# ----
# HB DAYSIM
honeybee = Honeybee_Honeybee()  # -> Vviiiiiiiiiizzz; disabled; plug-in component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
ladybug = Ladybug_Ladybug()  # -> Vviiiiiiiiiizzz; disabled; plug-in component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
item_2 = ListItem(List=srf, Index="5", Wrap=True)  # disabled
panel_9 = Panel("""void plastic OutsideFacade_30
0 
0 
5 0.30 0.30 0.30   0 0""")  # disabled
number_slider_2 = Slider(2, range=0..500)  # disabled
number_slider_3 = Slider(300, range=0..500)  # disabled
number_slider_4 = Slider(0.1, range=0..500)  # disabled
number_slider_5 = Slider(20, range=0..500)  # disabled
number_slider_6 = Slider(5, range=0..500)  # disabled
number_slider_7 = Slider(1000, range=0..3000)  # disabled
brep_3 = Brep(brep)  # disabled
srf_4 = Surface(item_2)  # disabled
panel_10 = Panel("1")  # disabled
dsparameters = Honeybee_DSParameters(outputUnits=panel_10, dgp_imageSize=250, onlyRunGlareAnalysis=True)  # -> DSParameters; disabled; plug-in component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
brep_4 = Brep(brep_3)  # disabled
number_slider_8 = Slider(10, range=0..10)  # disabled
panel_11 = Panel(".1")  # disabled
radparameters = Honeybee_RADParameters(
    quality=number_slider_2,
    ab=number_slider_6,
    ad=number_slider_7,
    as=number_slider_5,
    ar=number_slider_3,
    aa=number_slider_4)  # -> readMe, radParameters; disabled; plug-in component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
createhbsrfs = Honeybee_createHBSrfs(geometry=brep_4, RADMaterial=panel_9)  # -> readMe, simplify(HBSurface); disabled; plug-in component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
createhbsrfs_2 = Honeybee_createHBSrfs(geometry=srf, RADMaterial=panel_9)  # -> readMe, simplify(HBSurface); disabled; plug-in component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
gentestpts = Honeybee_GenerateTestPoints(testSurface=srf_4, gridSize=number_slider_8, distBaseSrf=panel_11)  # -> readMe, simplify(testPoints), simplify(ptsVectors), simplify(facesArea), simplify(mesh); disabled; plug-in component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
Z = UnitZ(Factor=panel_11)  # disabled
mjoin = MeshJoin(Meshes=flatten(gentestpts.mesh))  # disabled
move = Move(Geometry=mjoin, Motion=Z)  # -> Geometry, Transform; disabled
mesh_6 = Mesh(move.Geometry)  # disabled
annualdaylightsimulation = Honeybee_AnnualDaylightSimulation(
    epwWeatherFile=weather_file,
    testPoints=gentestpts.testPoints,
    ptsVectors=gentestpts.ptsVectors,
    testMesh=mesh_6,
    radParameters=radparameters.radParameters,
    DSParameters=dsparameters)  # -> analysisRecipe; disabled; plug-in component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
panel_12 = Panel("C:\ladybug\test")  # disabled
panel_13 = Panel("project")  # disabled
toggle = BooleanToggle(True)  # disabled
panel_14 = Panel("7")  # disabled
rundaylightanalysis = Honeybee_RunDaylightSimulation(
    HBObjects=flatten([createhbsrfs_2.HBSurface, createhbsrfs.HBSurface]),
    analysisRecipe=annualdaylightsimulation,
    writeRad=toggle,
    runRad=toggle,
    numOfCPUs=panel_14,
    workingDir=panel_12,
    radFileName=panel_13,
    overwriteResults=True)  # -> readMe, analysisType, resultsUnit, results, testPts, annual_analysis_files, radGeoFile, studyFolder, done; disabled; plug-in component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
item_3 = ListItem(List=rundaylightanalysis.testPts, Index=number_slider, Wrap=True)  # disabled
number_slider_9 = Slider(0.069, range=0..1)  # disabled
panel_15 = Panel(rundaylightanalysis.readMe)  # disabled
readradresults = Honeybee_ReadRADResult(analysisType=rundaylightanalysis.analysisType, writeToFile=False)  # -> readMe, unit, values; disabled; plug-in component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
panel_16 = Panel(rundaylightanalysis.annual_analysis_files)  # disabled
tag = TextTag3D(Location=gentestpts.testPoints, Size=number_slider_9, Justification=7)  # disabled
readallthedshourlyresults = Honeybee_ReadAllTheHourlyResultsFromAnnualDaylightStudy(illFilesAddress=rundaylightanalysis.annual_analysis_files, testPoints=rundaylightanalysis.testPts)  # -> iIllumLevelsNoDynamicSHD, iIllumLevelsDynamicSHDGroupI, iIllumLevelsDynamicSHDGroupII, iIlluminanceBasedOnOccupancy, shadingGroupInEffect; disabled; plug-in component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
number_slider_10 = Slider(1, range=1..12)  # disabled
number_slider_11 = Slider(1, range=1..31)  # disabled
number_slider_12 = Slider(14, range=1..24)  # disabled
panel_17 = Panel(rundaylightanalysis.resultsUnit)  # disabled
doy_hoy = Ladybug_DOY_HOY(days=number_slider_11, months=number_slider_10, hours=number_slider_12)  # -> HOY, DOY, date; disabled; plug-in component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
readdshourlyresults = Honeybee_ReadHourlyResultsFromAnnualDaylightStudy(illFilesAddress=panel_16, testPoints=gentestpts.testPoints, HOY=doy_hoy.HOY)  # -> iIllumLevelsNoDynamicSHD, iIllumLevelsDynamicSHDGroupI, iIllumLevelsDynamicSHDGroupII, iIlluminanceBasedOnOccupancy, shadingGroupInEffect; disabled; plug-in component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
recolormesh = Ladybug_RecolorMesh(analysisResult=readdshourlyresults.iIllumLevelsNoDynamicSHD, inputMesh=mesh_6)  # -> readMe, newMesh, newLegend, legendBasePt, meshColors, legendColors; disabled; plug-in component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
panel_18 = Panel(readallthedshourlyresults.iIllumLevelsNoDynamicSHD)  # disabled

# ---- group: Ground
data_5 = Data([0.2, 0.2, 0.2, 0.2, 0.2, 0.2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])
panel_19 = Panel(data_5)
obstobj_2 = ObstacleObject(Mesh=mesh_2, Albedo=panel_19, SpecCoeff=panel_19, ReflType="0", Tolerance="0.01", Name="ground", MT=Toggle(True))

# ---- group: AZIMUTH
data_6 = Data([8.415567703, 33.69912388, 56.58914543, 72.99109311, 85.75265625, 96.74276768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])

# ---- group: SunPath
importepw = Ladybug_ImportEpw(epwFile=weather_file)  # -> readMe, latitude, location, dryBulbTemperature, dewPointTemperature, relativeHumidity, windSpeed, windDirection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; disabled; plug-in component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
panel_20 = Panel("31")  # disabled
panel_21 = Panel("12")  # disabled
panel_22 = Panel("1")  # disabled
panel_23 = Panel("24")  # disabled
analysisperiod = Ladybug_AnalysisPeriod(fromMonth=panel_22, fromDay=panel_22, fromHour=panel_22, toMonth=panel_21, toDay=panel_20, toHour=panel_23)  # -> readMe, analysisPeriod; disabled; plug-in component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
toggle_2 = BooleanToggle(True)  # disabled
sunpath = Ladybug_SunPath(
    location=importepw.location,
    hour=12,
    day=21,
    month=12,
    timeStep=1,
    analysisPeriod=analysisperiod.analysisPeriod,
    dailyOrAnnualSunPath=True,
    solarOrStandardTime=toggle_2)  # -> readMe, sunVectors, sunAltitudes, sunAzimuths, port, sunSpheresMesh, sunPathCrvs, compassCrvs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; disabled; plug-in component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
panel_24 = Panel(sunpath.sunAzimuths)  # disabled
panel_25 = Panel(data_6)  # disabled

# ---- group: ALTITUDE
data_7 = Data([-65.34878984, -62.13426796, -54.95901857, -45.81747693, -35.88714072, -25.78253978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])

# ---- group: weather
panel_26 = Panel(data_3)
panel_27 = Panel(data)
panel_28 = Panel(data_2)

# ---- group: Analysis surface object
obstobj_3 = ObstacleObject(Mesh=mesh_4, Albedo=panel_8, SpecCoeff=panel_8, ReflType="0", Tolerance="0.01", Name="analysis", MT=Toggle(True))

# ----
hb_epcontextsrf = HoneybeeEPContextSurfaces(shdSurfaces=flatten(brep))  # -> HBContext; inputs shdSurfaces: list of Brep, justBoundingBox: Boolean; disabled
# ---------- hb_epcontextsrf: Python ----------
"""
prepare shading/context geometries

    Args:
        northVectorOrRotation: A vector that shows North or a number that shows
                               the rotation of the North from the Y axis
        bldgMasses: List of closed Breps as thermal zones.
    Returns:
        report: ...
        thermalZones: Thermal zone's geometries for visualiza
"""

ghenv.Component.Name = 'Honeybee EP context Surfaces'
ghenv.Component.NickName = 'HB_EPContextSrf'
ghenv.Component.Message = 'VER 0.0.61\nFEB_05_2017'
ghenv.Component.IconDisplayMode = ghenv.Component.IconDisplayMode.application
ghenv.Component.Category = "Honeybee"
ghenv.Component.SubCategory = "10 | Energy | Energy"
#compatibleHBVersion = VER 0.0.57\nNOV_04_2016
#compatibleLBVersion = VER 0.0.59\nFEB_01_2015
ghenv.Component.AdditionalHelpFromDocStrings = "2"

import rhinoscriptsyntax as rs
import Rhino as rc
import scriptcontext as sc
import os
import System
import Grasshopper.Kernel as gh
import uuid

tolerance = sc.doc.ModelAbsoluteTolerance
import math


def main(shdSurfaces, EPTransSchedule, meshingSettings, justBoundingBox):
    
    # import the classes
    if sc.sticky.has_key('honeybee_release'):

        try:
            if not sc.sticky['honeybee_release'].isCompatible(ghenv.Component): return -1
            if sc.sticky['honeybee_release'].isInputMissing(ghenv.Component): return -1
        except:
            warning = "You need a newer version of Honeybee to use this compoent." + \
            " Use updateHoneybee component to update userObjects.\n" + \
            "If you have already updated userObjects drag Honeybee_Honeybee component " + \
            "into canvas and try again."
            w = gh.GH_RuntimeMessageLevel.Warning
            ghenv.Component.AddRuntimeMessage(w, warning)
            return -1
        
        # don't customize this part
        hb_EPSrf = sc.sticky["honeybee_EPSurface"]
        hb_EPSHDSurface = sc.sticky["honeybee_EPShdSurface"]
        hb_RADMaterialAUX = sc.sticky["honeybee_RADMaterialAUX"]
        hb_EPObjectsAux = sc.sticky["honeybee_EPObjectsAUX"]()
        HBScheduleList = sc.sticky["honeybee_ScheduleLib"].keys()

        ########################################################################
        #----------------------------------------------------------------------#
        shdBreps = []
        # create bounding box of shading geometries
        if justBoundingBox:
            for brep in shdSurfaces:
                if brep.Faces.Count>1 or not brep.Faces[0].IsPlanar(sc.doc.ModelAbsoluteTolerance):
                    shdBreps.append(brep.GetBoundingBox(True).ToBrep())
                else:
                    shdBreps.append(brep)
        else:
            shdBreps = shdSurfaces
        
        shadingClasses = []
        shadingMeshPreview = []
        
        if meshingSettings == None:
            mp = rc.Geometry.MeshingParameters.Minimal
            mp.SimplePlanes = True
        else:
            mp = meshingSettings
        
        def getRadMaterialName(radMaterial):
            nameStr = radMaterial.split(" ")[2]
            name =  nameStr.split("\n")[0]
            return name
        
        for brepCount, brep in enumerate(shdBreps):
            if brep != None:
                isPlanar = True
                # check planarity
                for face in brep.Faces:
                    if not face.IsPlanar(tolerance):
                        isPlanar = False
                        break
                
                shadingBreps = []
                if not isPlanar:
                    meshArray = rc.Geometry.Mesh.CreateFromBrep(brep, mp)
                    for mesh in meshArray:
                        for meshFace in range(mesh.Faces.Count):
                            vertices = list(mesh.Faces.GetFaceVertices(meshFace))[1:]
                            vertices = vertices + [sc.doc.ModelAbsoluteTolerance]
                            # create the brep from mesh
                            shdBrep = rc.Geometry.Brep.CreateFromCornerPoints(*vertices)
                            shadingBreps.append(shdBrep)
                else:
                    for face in brep.Faces:
                        shadingBreps.append(face.DuplicateFace(False))
                
                for faceCount, shdBrep in enumerate(shadingBreps):
                        thisShading = hb_EPSHDSurface(shdBrep, 1000*brepCount + faceCount, 'shdSrf_' + `brepCount` + '_' + `faceCount` + "_" + str(uuid.uuid4()))
                        
                        # add transmittance schedule if any
                        if EPTransSchedule!=None:
                            schedule= EPTransSchedule.upper()
                            if schedule!=None and not schedule.lower().endswith(".csv") and schedule not in HBScheduleList:
                                msg = "Cannot find " + schedule + " in Honeybee schedule library."
                                print msg
                                ghenv.Component.AddRuntimeMessage(gh.GH_RuntimeMessageLevel.Warning, msg)
                                return -1
                            elif schedule!=None and schedule.lower().endswith(".csv"):
                                # check if csv file is existed
                                if not os.path.isfile(schedule):
                                    msg = "Cannot find the shchedule file: " + schedule
                                    print msg
                                    ghenv.Component.AddRuntimeMessage(gh.GH_RuntimeMessageLevel.Warning, msg)
                                    return -1
                            
                            thisShading.TransmittanceSCH = schedule
                        
                        # add the Rad Material if any
                        if RADMaterial!=None:
                            # if it is just the name of the material make sure it is already defined
                            if len(RADMaterial.split(" ")) == 1:
                                # if the material is not in the library add it to the library
                                if not hb_RADMaterialAUX.isMatrialExistInLibrary(RADMaterial):
                                    warningMsg = "Can't find " + RADMaterial + " in RAD Material Library.\n" + \
                                                "Add the material to the library and try again."
                                    ghenv.Component.AddRuntimeMessage(gh.GH_RuntimeMessageLevel.Warning, warningMsg)
                                    return
                                
                                try:
                                    thisShading.setRADMaterial(RADMaterial)
                                except Exception, e:
                                    print e
                                    warningMsg = "You are using an old version of Honeybee_Honeybee! Update your files and try again."
                                    print warningMsg
                                    ghenv.Component.AddRuntimeMessage(gh.GH_RuntimeMessageLevel.Warning, warningMsg)
                                    return
                                
                                addedToLib = True
                            else:
                                
                                # try to add the material to the library
                                addedToLib, thisShading.RadMaterial = hb_RADMaterialAUX.analyseRadMaterials(RADMaterial, True)
                                
                            if addedToLib==False:
                                warningMsg = "Failed to add " + RADMaterial + " to the Library."
                                ghenv.Component.AddRuntimeMessage(gh.GH_RuntimeMessageLevel.Warning, warningMsg)
                                return
                        
                        # add shading to the list
                        shadingClasses.append(thisShading)
                
        # add to the hive
        hb_hive = sc.sticky["honeybee_Hive"]()
        HBContext  = hb_hive.addToHoneybeeHive(shadingClasses, ghenv.Component)
        return HBContext
        ################################################################################################
    else:
        print "You should first let Honeybee to fly..."
        w = gh.GH_RuntimeMessageLevel.Warning
        ghenv.Component.AddRuntimeMessage(w, "You should first let Honeybee to fly...")
        return -1
        

if _shdSurfaces and _shdSurfaces[0]!=None:
    # add cleaning function
    result= main(_shdSurfaces, EPTransSchedule_, meshingSettings_, justBoundingBox_)
    
    if result != -1: HBContext = result
# ---------- end hb_epcontextsrf ----------

# ---- group: Latitude
panel_29 = Panel("47.479")

# ---- group: Longitude
panel_30 = Panel("8.530")

# ---- group: year
panel_31 = Panel("2013")

# ----
panel_32 = Panel("C:\EnergyPlusV8-1-0\WeatherData\CH_ZH_original.epw")  # disabled

# ----
# HB EnergyPlus
ladybug_2 = Ladybug_Ladybug()  # -> Vviiiiiiiiiizzz; disabled; plug-in component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
honeybee_2 = Honeybee_Honeybee()  # -> Vviiiiiiiiiizzz; disabled; plug-in component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
bldgprograms = Honeybee_bldgPrograms({"Office": 0, "Retail": 1, "MidriseApartment": 2, "PrimarySchool": 3, "SecondarySchool": 4, "SmallHotel": 5, "LargeHotel": 6, "Hospital": 7, "Outpatient": 8, "Warehouse": 9, "SuperMarket": 10, "FullServiceRestaurant": 11, "QuickServiceRestaurant": 12}, selected="MidriseApartment")  # disabled
listzoneprograms = Honeybee_ListZonePrograms(bldgProgram=bldgprograms)  # -> MidriseApartmentZonePrograms; disabled; plug-in component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
list = Honeybee_ItemSelector(
    listzoneprograms,
    {"MidriseApartment::Apartment", "MidriseApartment::Office", "MidriseApartment::Corridor"}, selected="MidriseApartment::Apartment")  # disabled
toggle_3 = BooleanToggle(True)  # disabled
mass2zone = Honeybee_Masses2Zones(zoneMasses=flatten(brep_2), zonePrograms=list, isConditioned=True, maxRoofAngle=30, createHBZones=toggle_3)  # -> readMe, HBZones; disabled; plug-in component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
toggle_4 = BooleanToggle(True)  # disabled
solveadjc = Honeybee_SolveAdjacencies(HBZones=flatten(mass2zone.HBZones), removeCurrentAdjc=False, findAdjc=toggle_4)  # -> readMe, HBZonesWADJ; disabled; plug-in component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
panel_33 = Panel("C:\ladybug\test2")  # disabled
panel_34 = Panel("hourly")  # disabled
panel_35 = Panel("12")  # disabled
panel_36 = Panel("31")  # disabled
panel_37 = Panel("24")  # disabled
panel_38 = Panel("1")  # disabled
toggle_5 = BooleanToggle(True)  # disabled
epoutput = Honeybee_GenerateEPOutput(
    zoneGainsAndLosses="False",
    zoneComfortMetrics="False",
    surfaceTempAnalysis="False",
    surfaceEnergyAnalysis=toggle_5,
    timestep=panel_34)  # -> report, flatten(simulationOutputs); disabled; plug-in component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
analysisperiod_2 = Ladybug_AnalysisPeriod(fromMonth=panel_38, fromDay=panel_38, fromHour=panel_38, toMonth=panel_35, toDay=panel_36, toHour=panel_37)  # -> readMe, analysisPeriod; disabled; plug-in component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
panel_39 = Panel("test2")  # disabled
toggle_6 = BooleanToggle(False)  # disabled
runenergysimulation = Honeybee_RunEnergySimulation(
    epwFile=panel_32,
    analysisPeriod=analysisperiod_2.analysisPeriod,
    HBZones=flatten(solveadjc.HBZonesWADJ),
    HBContext=flatten(hb_epcontextsrf),
    simulationOutputs=flatten(epoutput.simulationOutputs),
    writeIdf=toggle_6,
    runEnergyPlus=toggle_6,
    workingDir=panel_33,
    idfFileName=panel_39)  # -> report, idfFileAddress, resultFileAddress; disabled; plug-in component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

# ---- group: ANNUAL SIMULATION
irrmshy = IrradiationMeshYear(
    AnalysisObjects=obstobj_3,
    ObstacleObjects=[obstobj, obstobj_2],
    Latitude=panel_29,
    Longitude=panel_30,
    Year=panel_31,
    DNI=panel_26,
    DHI=panel_27,
    Azimuth=data_6,
    Altitude=data_7,
    MainSkyRes="3",
    MainInterpMode="1",
    SpecBounces="0",
    SpecInterpMode="0",
    DiffIReflSkyRes="1",
    DiffIReflMode="2",
    MT=Toggle(True))
visumshsol = VisualizeMeshSolar(
    Mesh=mesh_4,
    I=irrmshy,
    Value="0",
    Hour=Slider(273, range=0..8759),
    Min="600000",
    Max="800000",
    Clr=Slider(1, range=0..2))
readresults = ReadResults(Mesh=mesh_4, I=irrmshy, Value=Slider(4, range=0..7), SP=Slider(0, range=0..9))  # -> Results, SP
panel_40 = Panel(readresults.Results)

# ---- group: HOURLY SIMULATION
irrmshh = IrradiationMeshhour(
    AnalysisObjects=obstobj_3,
    ObstacleObjects=[obstobj, obstobj_2],
    Latitude=panel_29,
    Longitude=panel_30,
    Year=panel_31,
    Month=Slider(1, range=1..12),
    Day=Slider(2, range=1..12),
    Hour=Slider(13, range=0..23),
    DNI=panel_26,
    DHI=panel_27,
    Azimuth=data_6,
    Altitude=data_7,
    MainSkyRes="2",
    SpecBounces="0",
    DiffIReflSkyRes="2",
    DiffIReflSkyRes2nd="1",
    MT=Toggle(True))  # -> Vec, Results, Irefl
readresults_2 = ReadResults(Mesh=mesh_4, I=irrmshh.Results, Value=Slider(4, range=0..7), SP=Slider(0, range=0..100))  # -> Results, SP
visumshsol_2 = VisualizeMeshSolar(
    Mesh=mesh_4,
    I=irrmshh.Results,
    Value="4",
    Hour=Slider(0, range=0..8759),
    Min="120",
    Max="135",
    Clr=Slider(1, range=0..2))
panel_41 = Panel(readresults_2.Results)

# ----
# Your List of Hourly Radiation Values Will be Here
# Connect this Here and Wait
# This one takes all the panel-patches
# and averages them together into one 8760-profile
ladybug_3 = Ladybug_Ladybug()  # -> Vviiiiiiiiiizzz; disabled; plug-in component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
panel_42 = Panel("1")  # disabled
panel_43 = Panel("8760")  # disabled
panel_44 = Panel("C:\EnergyPlusV8-2-0\WeatherData\CH_ZH_original.epw")  # disabled
series = Series(Start=panel_42, Step=1, Count=panel_43)  # -> simplify(graft(Series)); disabled
toggle_7 = BooleanToggle(True)  # disabled
panel_45 = Panel(series)  # disabled
gencumulativeskymtx = Ladybug_GenCumulativeSkyMtx(epwFile=panel_44, skyDensity=0, useOldRes=True, runIt=toggle_7)  # -> readMe, cumulativeSkyMtx; disabled; plug-in component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
selectskymtx = Ladybug_selectSkyMtx(cumulativeSkyMtx=gencumulativeskymtx.cumulativeSkyMtx, removeDiffuse=False, removeDirect=False)  # -> readMe, selectedSkyMtx; disabled; plug-in component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
selectskymtx_2 = Ladybug_selectSkyMtx(cumulativeSkyMtx=gencumulativeskymtx.cumulativeSkyMtx, HOY=series, removeDiffuse=False, removeDirect=False)  # -> readMe, selectedSkyMtx; disabled; plug-in component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
toggle_8 = BooleanToggle(True)  # disabled
panel_46 = Panel("1")  # disabled
panel_47 = Panel("0.01")  # disabled
panel_48 = Panel("""1
2
5
1
2""")  # disabled

# ---- group: Building, for which to obtain solar profiles
panel_49 = Panel("10")  # disabled
mesh_uv_3 = MeshSurface(Surface=srf, UCount=panel_49, VCount=panel_49, Overhang=True, Equalize=False)  # disabled

# ----
item_4 = ListItem(List=mesh_uv_3, Index="5", Wrap=True)  # disabled

# ---- group: Building, for which to obtain solar profiles (continued)
mesh_7 = Mesh(item_4)  # disabled

# ----
# LadyBug  Cumul. Sky
radiationanalysis = Ladybug_RadiationAnalysis(
    north=0,
    geometry=flatten(mesh_7),
    context=flatten(mesh_3),
    gridSize=panel_46,
    disFromBase=panel_47,
    selectedSkyMtx=flatten(selectskymtx.selectedSkyMtx),
    runIt=toggle_8)  # -> readMe, contextMesh, analysisMesh, testPts, testVec, port, radiationResult, radiationMesh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; disabled; plug-in component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
rtradiationanalysis = Ladybug_RealTimeRadiationAnalysis(selectedSkyMatrix=selectskymtx_2.selectedSkyMtx, intersectionMatrix=radiationanalysis.intersectionMtx)  # -> radiationResult; disabled; plug-in component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
data_8 = Data(flatten(rtradiationanalysis))  # disabled
vb = VBScript(x=data_8)  # -> out, A; inputs x: list; disabled
# ---------- vb: VB ----------
    Dim i, u As Integer
    Dim n(8760-1) As Double
    For i = 0 To 8760 - 1
      n(i) = 0
      For u = 0 To 99
        n(i) = n(i) + x(i * 100 + u)
      Next
      n(i) = n(i) / 100
    Next

    A = n
# ---------- end vb ----------
panel_50 = Panel(data_8)  # disabled
panel_51 = Panel(vb.A)  # disabled
