# Grasshopper definition sunpath_examle.gh (Grasshopper 1.0.7)
# plug-ins: GHSolar

dni = Data([0, 0, 0, 0, 0, 0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])

# ---- group: DHI
data = Data([0, 0, 0, 0, 0, 0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])

# ----
mesh = Mesh([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])
pt = Point(Point(1.070618619, -22.63256583, 0))
number_slider = Slider(14.189, range=-90..90)
panel = Panel([Slider(-4.839, range=-90..90), number_slider])
skydome = GHSkydome(
    RecursionLevel=Slider(3, range=0..5),
    Viewfactors=Toggle(False),
    CumSkyMatrix=Toggle(False),
    SunPath=Toggle(True),
    SolarVec=Toggle(True),
    HOY=Slider(2503, range=0..8759),
    Location=panel,
    DNI=dni,
    DHI=data,
    Size=Slider(1.025, range=0..2),
    Context=mesh,
    Sp=pt)  # -> Mesh, Vectors, Sunpaths, SunGeo, Sunsetrise
nickname = GHTestSunriseSunset(Theta=number_slider, Day=Slider(181, range=1..365), Sunrise=Toggle(False))  # -> Azimuth, DeclinationAngle, HourAngle, Altitude, Daylength, Sunrisehour
line = Line(skydome.Sunsetrise)

# ---- group: Sunrise or Sunset azimuth?
panel_2 = Panel([nickname.Azimuth, nickname.DeclinationAngle, nickname.HourAngle, nickname.Altitude, nickname.Daylength, nickname.Sunrisehour])
